# Dynamo graph Dynamo script print.dyn (Dynamo 2.6.1.8786)
# packages: archi-lab.net 2021.25.17, Clockwork for Dynamo 1.x 1.34.0

# group: Print
view_sets = ViewSetUi()  # nothing selected
views = Custom[ViewSheetSet.Views](viewsSheetSet=view_sets)  # package Clockwork for Dynamo 1.x; Retrieves all the views/sheets in a given view/sheet set.
print_range = PrintRangeUi("Select")
boolean = BoolSelector(true)
string = StringInput("Microsoft Print to PDF")
print_settings = PrintSettingUi("Default")
file_path = Filename("Byggeprojekt\K02 - Contractor (Tømrer)\Tømrer.pdf")
code_block = CodeBlock { "Tømrer"; }
python_script = Python(IN[0]=code_block)
# ---------- python_script.python (15 lines) ----------
# Load the Python Standard and DesignScript Libraries
import sys
import clr
clr.AddReference('ProtoGeometry')
from Autodesk.DesignScript.Geometry import *

dataEnteringNode = IN

x=IN[0]

if x=='Tømrer': 
	x="True"
else:
	x="False"
OUT = x
# ----------------------------------------
watch = Watch(python_script)
print_pdf = Custom[Print PDF](views=views, printRange=print_range, combinedFile=boolean, printerName=string, printSettings=print_settings, filePath=file_path, runIt=watch)  # package archi-lab.net; This node will allow you to initiate a printing routine in revit from a set of views/sheets, printer name, print settings and print range.
