# Dynamo graph Dynamo script.dyn (Dynamo 2.6.1.8786)
# packages: Data-Shapes 2021.2.91, Clockwork for Dynamo 1.x 1.34.0, Genius Loci 2021.4.13, archi-lab.net 2021.25.17

# group: Data-Shapes
string = StringInput("Udvælg Fag")
string_2 = StringInput("OK")
code_block = CodeBlock { "VVS'er"; "Tømrer"; }
list_create = List.Create(item0=code_block.out0, item1=code_block.out1)
categories = Categories("OST_DuctCurves")
categories_2 = Categories("OST_Walls")
list_create_2 = List.Create(item0=categories, item1=categories_2)
boolean = BoolSelector(false)
boolean_2 = BoolSelector(false)
listview_data = Custom[Listview Data](Keys=list_create, Values=list_create_2, SortItems_optionnal=boolean, ShowId_optionnal=boolean_2)  # package Data-Shapes
boolean_3 = BoolSelector(false)
string_3 = StringInput("Annuller")
multipleinputform = Custom[MultipleInputForm ++](Description_optional=string, ButtonText_optional=string_2, Inputs=listview_data, Toggle=boolean_3, CancelButtonText_optional=string_3)  # package Data-Shapes

# group: Hide elementer
views = Views("{3D}")
listFlatten = Python(IN[0]=multipleinputform.User_Inputs)  # "Python.ListFlatten"
# ---------- listFlatten.python (44 lines) ----------
import clr
import sys
sys.path.append('C:\Program Files (x86)\IronPython 2.7\Lib')
import System
from System import Array
from System.Collections.Generic import *
clr.AddReference('ProtoGeometry')
from Autodesk.DesignScript.Geometry import *
clr.AddReference("RevitNodes")
import Revit
clr.ImportExtensions(Revit.Elements)
clr.ImportExtensions(Revit.GeometryConversion)
clr.AddReference("RevitServices")
import RevitServices
from RevitServices.Persistence import DocumentManager
from RevitServices.Transactions import TransactionManager

clr.AddReference("RevitAPI")
clr.AddReference("RevitAPIUI")

import Autodesk
from Autodesk.Revit.DB import *
from Autodesk.Revit.UI import *
import collections

doc = DocumentManager.Instance.CurrentDBDocument
uiapp = DocumentManager.Instance.CurrentUIApplication
app = uiapp.Application
uidoc = uiapp.ActiveUIDocument


#Inputs
unflattened_list = IN[0]

#Type code bellow

def flattenList(unflattened_list):
	if isinstance(unflattened_list,collections.Iterable):
		return [sub_element for element in unflattened_list for sub_element in flattenList(element)]
	else:
		return [unflattened_list]

#Output
OUT = flattenList(IN[0])
# ----------------------------------------
temporarilyIsolateCategory = Custom[View.TemporarilyIsolateCategory](view=views, category=listFlatten)  # package Clockwork for Dynamo 1.x; Temporarily isolates categories in the given view
convertTemporaryHideIsolateToPermanent = Custom[View.ConvertTemporaryHideIsolateToPermanent](view=temporarilyIsolateCategory.view)  # package Clockwork for Dynamo 1.x; Convert all temporary hidden elements or categories to permanently hidden in the given view.

# group: Export IFC
directory_path = Directory("D:\Sharepoint\Aalborg Universitet\Gruppe - 1.317 - 3. semester 1.317\Semesterprojekt\Rapport\Scripts\Testmappe")
string_4 = StringInput("TEST ABC")
export_ifc = Custom[Export IFC](DirectoryPath=directory_path, view=convertTemporaryHideIsolateToPermanent.view, Filename=string_4)  # package Genius Loci; Export View to IFC file. For use with the Select Phase node. Some other IFC options are embedded inside the python script.
watch = Watch(export_ifc)

# group: Print Tømrer PDF
view_sets = ViewSetUi("Set 1")
print_range = PrintRangeUi("Select")
string_5 = StringInput("Microsoft Print to PDF")
print_settings = PrintSettingUi("Default")
directory_path_2 = Directory("D:\Sharepoint\Aalborg Universitet\Gruppe - 1.317 - 3. semester 1.317\Semesterprojekt\Rapport\Scripts\Byggeprojekt\K02 - Contractor (Tømrer)")
python_script = Python(IN[0]=listFlatten)
# ---------- python_script.python (16 lines) ----------
# Load the Python Standard and DesignScript Libraries
import sys
import clr
clr.AddReference('ProtoGeometry')
from Autodesk.DesignScript.Geometry import *

dataEnteringNode = IN

x=IN[0]


if x=="Tømrer":
	x="True"
else:
	x="False"
OUT = x
# ----------------------------------------
print_pdf = Custom[Print PDF](views=view_sets, printRange=print_range, printerName=string_5, printSettings=print_settings, filePath=directory_path_2, runIt=python_script)  # package archi-lab.net; This node will allow you to initiate a printing routine in revit from a set of views/sheets, printer name, print settings and print range.

# group: Genlæs QR kode
directory_path_3 = Directory("D:\Sharepoint\Aalborg Universitet\Gruppe - 1.317 - 3. semester 1.317\Semesterprojekt\Rapport\Scripts\Byggeprojekt\K02 - Contractor (Tømrer)")  # graph input
fromPath = DirectoryObject(path=directory_path_3)  # "Directory.FromPath"
code_block_2 = CodeBlock { "*.jpg"; }
getDirectoryContents = FileSystem.GetDirectoryContents(directory=fromPath, searchString=code_block_2, includeSubdirectories=fromPath)
python_script_2 = Python(IN[0]=getDirectoryContents.files)
# ---------- python_script_2.python (41 lines) ----------
import clr
clr.AddReference('RevitAPI')
from Autodesk.Revit.DB import *
clr.AddReference('RevitNodes')
import Revit
clr.ImportExtensions(Revit.GeometryConversion)
clr.ImportExtensions(Revit.Elements)

clr.AddReference('RevitServices')
import RevitServices
from RevitServices.Persistence import DocumentManager
from RevitServices.Transactions import TransactionManager

doc = DocumentManager.Instance.CurrentDBDocument


filePaths = IN[0]

#Isolering af filenavne
fileNames = []
for path in filePaths:
	tempName = path.split('\\')
  	fileNames.append(tempName[len(tempName)-1])
   #vælg billede
imgs = FilteredElementCollector(doc).OfCategory(BuiltInCategory.OST_RasterImages).WhereElementIsElementType().ToElements()

reloadedFiles = []

  #Genindlæs billede
  
TransactionManager.Instance.EnsureInTransaction(doc)
for fileName in fileNames:
  	for i in imgs:
 		imageName = i.ToDSType(True).Name
 		if  imageName == fileName:
 			i.Reload()
  			reloadedFiles.append(imageName)

TransactionManager.Instance.TransactionTaskDone()

OUT = reloadedFiles
# ----------------------------------------

# group: Print VVS'er PDF
view_sets_2 = ViewSetUi("Set 1")
print_range_2 = PrintRangeUi("Select")
string_6 = StringInput("Microsoft Print to PDF")
string_7 = StringInput("Default")
directory_path_4 = Directory("D:\Sharepoint\Aalborg Universitet\Gruppe - 1.317 - 3. semester 1.317\Semesterprojekt\Rapport\Scripts\Byggeprojekt\K02 - Contractor (Tømrer)")
python_script_3 = Python()  # unwired: IN[0]
# ---------- python_script_3.python (16 lines) ----------
# Load the Python Standard and DesignScript Libraries
import sys
import clr
clr.AddReference('ProtoGeometry')
from Autodesk.DesignScript.Geometry import *

dataEnteringNode = IN

x=IN[0]


if x=="VVS'er":
	x="True"
else:
	x="False"
OUT = x
# ----------------------------------------
watch_2 = Watch(python_script_3)
print_pdf_2 = Custom[Print PDF](views=view_sets_2, printRange=print_range_2, printerName=string_6, printSettings=string_7, filePath=directory_path_4, runIt=watch_2)  # frozen
get_views_from_view_set = Custom[Get Views from View Set](viewSet=view_sets_2)  # package archi-lab.net; This node will take a name of a view set and return views/sheet elements contained in it.
